# Grasshopper definition GHSunPath.gh (Grasshopper 1.0.8)

panel = Panel("https://climate.onebuilding.org/WMO_Region_4_North_and_Central_America/California_Climate_Zones/California_CTZ_2016/USA_CA_Van.Nuys.AP.722886_CTZ2016.zip")
file_path = FilePath("C:\Users\macho\AppData\Roaming\ladybug_tools\weather\USA_CA_Van.Nuys.AP.722886_CTZ2016\USA_CA_Van.Nuys.AP.722886_CTZ2016.epw")
file_path_2 = FilePath("C:\Users\macho\AppData\Roaming\ladybug_tools\weather\USA_CA_Van.Nuys.AP.722886_CTZ2016\USA_CA_Van.Nuys.AP.722886_CTZ2016.epw")
importloc = LBImportLocation(epw_file=file_path)  # -> location; plug-in component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
downloadepw = LBDownloadWeather(weather_URL=panel)  # -> epw_file, stat_file, ddy_file; plug-in component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
importloc_2 = LBImportLocation(epw_file=file_path_2)  # -> location; plug-in component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
importepw = LBImportEPW(epw_file=downloadepw.epw_file)  # -> location, dry_bulb_temperature, dew_point_temperature, relative_humidity, wind_speed, wind_direction, direct_normal_rad, diffuse_horizontal_rad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; plug-in component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
sunpath = LBSunPath(scale=1)  # -> out, vectors, altitudes, azimuths, hoys, sun_pts, analemma, daily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; plug-in component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
end_hour = Integer()
end_month = Integer()
end_day = Integer()
start_day = Integer()
start_hour = Integer()
geometry = Geometry()

custom_preview = CustomPreview(Geometry=geometry, Material=ColourSwatch(SwatchColor=RGB(255, 255, 255)))

start_month = Integer()
hoy = LBCalculateHOY()  # -> flatten(hoy), flatten(doy), flatten(date); plug-in component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
analysisperiod = LBAnalysisPeriod(
    start_month=start_month,
    start_day=start_day,
    start_hour=start_hour,
    end_month=end_month,
    end_day=end_day,
    end_hour=end_hour,
    timestep="1")  # -> period, hoys, dates; plug-in component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
number_slider = Slider(1.4, range=0..10)
point = Point(Point(-551916.1766, 61195.65874, 0))
sunpath_2 = LBSunPath(
    location=importepw.location,
    hoys=analysisperiod.hoys,
    center_pt=point,
    scale=number_slider,
    daily=Toggle(True),
    data=importepw.dry_bulb_temperature)  # -> out, vectors, altitudes, azimuths, hoys, sun_pts, sunpath_curves, sun_points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; plug-in component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
multiplication = Multiplication(A=number_slider, B="100000")
epwmap = LBEPWmap(epw_map=Toggle(True))  # -> Output; plug-in component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
curve = Curve(sunpath_2.daily)
curve_2 = Curve(sunpath_2.analemma)
crv = Curve(sunpath_2.sunpath_curves)
pt = Point(sunpath_2.sun_points)
geometry_pipeline = GeometryPipeline(
    GroupByLayer=False,
    GroupByType=False,
    IncludeHidden=True,
    IncludeLocked=True,
    LayerFilter="Massing",
    NameFilter="*",
    SublayerFiltering=True,
    TypeFilter=1073741848)
custom_preview_2 = CustomPreview(Geometry=curve_2, Material=ColourSwatch(SwatchColor=RGB(247, 255, 0)))
custom_preview_3 = CustomPreview(Geometry=curve, Material=ColourSwatch(SwatchColor=RGB(0, 38, 255)))
mesh_sphere = MeshSphere(Base=sunpath_2.sun_pts, Radius=Slider(5202, range=0..10000), UCount=10, VCount=20)
geometry_2 = Geometry(geometry_pipeline)
directsunhours = LBDirectSunHours(
    vectors=flatten(sunpath_2.vectors),
    geometry=flatten(geometry_2),
    grid_size=Slider(578, range=0..10000),
    offset_dist=Slider(16, range=0..100),
    run=Toggle(True))  # -> out, points, results, mesh, legend, title, int_mtx; plug-in component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
point_2 = Point()
line_sdl = LineSDL(Start=sunpath_2.sun_pts, Direction=sunpath_2.vectors, Length=multiplication)
legend_geom = Geometry(directsunhours.legend)
sphere = Sphere(Base=point_2, Radius=Slider(3226, range=0..100000))
analysis_mesh = Mesh(directsunhours.mesh)
custom_preview_4 = CustomPreview(Geometry=sphere, Material=ColourSwatch(SwatchColor=RGB(255, 179, 28)))
