# Grasshopper definition unnamed.gh (Grasshopper 1.0.8)

py3 = Python3Script()  # -> out, a, b, c, d, e, f, g, h2
# ---------- py3: Python ----------
import Rhino
import json
from System.Net import WebClient

# ============================================================
# 1. PYRAMID GEOMETRY
# ============================================================
def AddBrepPyramid(levels_in, size_in, gap_in):
    levels = int(levels_in) if levels_in is not None else 5
    size = float(size_in) if size_in is not None else 10.0
    gap = float(gap_in) if gap_in is not None else 2.0

    boxes = []
    for layer in range(levels):
        count = levels - layer
        offset_z = layer * (size + gap)
        for i in range(count):
            for j in range(count):
                shift = layer * (size + gap) / 2
                offset_x = i * (size + gap) + shift
                offset_y = j * (size + gap) + shift
                pt0 = Rhino.Geometry.Point3d(offset_x, offset_y, offset_z)
                pt1 = Rhino.Geometry.Point3d(
                    offset_x + size,
                    offset_y + size,
                    offset_z + size
                )
                box = Rhino.Geometry.BoundingBox(pt0, pt1)
                boxes.append(box.ToBrep())
    return boxes


# ============================================================
# 2. FALLBACK FROM GH INPUTS
# ============================================================
web_x = x
web_h = h
web_z = z

web_edge = edge
web_lineStrength = lineStrength
web_lineFactor = lineFactor
web_load = load
web_reset = reset
web_run = run

web_curves = []


# ============================================================
# 3. LOAD FROM WEB
# ============================================================
url = "http://localhost:3001/api/compute/params"

try:
    wc = WebClient()
    wc.Headers.Add("Accept", "application/json")
    s = wc.DownloadString(url)
    data = json.loads(s)

    web_x = data.get("x", web_x)
    web_h = data.get("h", web_h)
    web_z = data.get("z", web_z)

    web_edge = data.get("edge", web_edge)
    web_lineStrength = data.get("lineStrength", web_lineStrength)
    web_lineFactor = data.get("lineFactor", web_lineFactor)
    web_load = data.get("load", web_load)
    web_reset = data.get("reset", web_reset)
    web_run = data.get("run", web_run)

    # -------- CURVES FROM WEB --------
    cr = data.get("cr", [])
    if isinstance(cr, list):
        for it in cr:
            try:
                rh_json = it.get("data", None)
                if not rh_json:
                    continue

                if isinstance(rh_json, str):
                    geom_dict = json.loads(rh_json)
                else:
                    geom_dict = rh_json

                obj = Rhino.Runtime.CommonObject.FromJSON(geom_dict)

                if obj and isinstance(obj, Rhino.Geometry.Curve):
                    web_curves.append(obj)
            except:
                pass

except Exception as e:
    err = str(e)


# ============================================================
# 4. RESET / RUN
# ============================================================
if web_reset:
    pyramid = []
else:
    if web_run:
        pyramid = AddBrepPyramid(web_x, web_h, web_z)
    else:
        pyramid = []


# ============================================================
# 5. OUTPUTS
# ============================================================
a = pyramid        # Breps
b = web_curves     # Curves from web

c = web_edge
d = web_lineStrength
e = web_lineFactor
f = web_load
g = web_reset
h2 = web_run
# ---------- end py3 ----------

# ---- group: User_Input
edgelengthfactor = Slider(0.01, range=0..0.01)
linelengthfactor = Slider(0.5, range=0..3)
linelengthstrength = Slider(8, range=0..20)
loadfactor = Slider(1.62134, range=0..40.04001)
reset = Button()
run = BooleanToggle(True)

# ----
crv = Curve(py3.b)
cluster = Cluster(C_3=crv, d2=crv, C=crv, L=crv, crv_3=crv, C_2=crv, crv_5=crv)  # -> pt_5, mesh_5, line_7, pt_14, pt_13, number_slider
cluster_2 = Cluster_2(
    G=cluster.mesh_5,
    mesh=cluster.mesh_5,
    lengthfactor=py3.c,
    C=cluster.line_7,
    line=cluster.line_7,
    B_2=py3.e,
    A=cluster.pt_14,
    strength=py3.d,
    B=cluster.pt_13,
    M=cluster.mesh_5,
    P=cluster.pt_14,
    pt=cluster.pt_5,
    T=cluster.pt_13,
    F=cluster.number_slider,
    crv=crv,
    F_2=py3.f)
bouncysolver = BouncySolver(GoalObjects=cluster_2, Reset=py3.g, Threshold=1e-15, Tolerance=0.0001, Damping=0.99, Iterations=10, On=py3.h2)  # -> I, V, O

# ---- group: RH_OUT
mesh = Mesh(bouncysolver.O)
mesh_2 = Mesh(py3.a)
crv_2 = Curve(bouncysolver.O)

# ==== cluster Cluster
panel = Panel(""".2
-.2""")
C = ClusterInput()
C_2 = ClusterInput()
explode = Explode(Curve=C, Recursive=True)  # -> flatten(Segments), Vertices
offset = OffsetCurve(Curve=graft(C_2), Distance=panel, Corners=1)
L = ClusterInput()
trim = TrimTree(Tree=offset, Depth=1)
mcx = MultipleCurves(Curves=explode.Segments)  # -> Points, IndexA, IndexB, ParamA, ParamB
lng = ListLength(List=L)
d2 = ClusterInput()
loft = Loft(Curves=trim, Options={Adjust=False, Closed=False, LoftEnds=0, LoftSimp=0, LoftType=0, Rebuild=10, Refit=0.01})
merge = Merge(Data1=mcx.ParamA, Data2=mcx.ParamB)
merge_2 = Merge(Data1=mcx.IndexA, Data2=[mcx.IndexB, d2])
series = Series(Start=0, Step=1, Count=lng)
crv = Curve(loft)
equals = Equality(FirstNumber=merge_2, SecondNumber=graft(series))  # -> Equality, Inequality
runion = RegionUnion(Curves=flatten(crv))
dispatch = Dispatch(List=merge, DispatchPattern=equals.Equality)  # -> ListA, ListB
C_3 = ClusterInput()
boundary = BoundarySurfaces(Edges=runion)
shatter = Shatter(Curve=graft(C_3), Parameters=dispatch.ListA)
custom_mesh_settings = SettingsCustom(
    StitchSeams=True,
    SimplePlanes=False,
    Refine=True,
    MinCount=16,
    MaxCount=400,
    AspectRatio=20,
    MaxDistance=0,
    MaxAngle=20,
    MinEdge=".2",
    MaxEdge=".2")
srf = Surface(boundary)
crv_2 = Curve(shatter)
end = EndPoints(Curve=crv_2)  # -> Start, End
debrep = DeconstructBrep(Brep=srf)  # -> Faces, Edges, Vertices
mesh = MeshBrep(Brep=srf, Settings=custom_mesh_settings)
pt = Point(flatten([end.End, end.Start]))
pgroups = PointGroups(Points=pt, Distance=Slider(0.01, range=0..0.01))  # -> Groups, Indices
pt_2 = Point(pgroups.Groups)
prune = PruneTree(Tree=pt_2, Minimum="2", Maximum="10")
item = ListItem(List=prune, Index=0, Wrap=True)
lng_2 = ListLength(List=prune)
pt_3 = Point(item)
pt_4 = Point(debrep.Vertices)
pt_5 = ClusterOutput(pt_3)
cps = ClosestPoints(Point=pt_3, Cloud=pt_4, Count=lng_2)  # -> ClosestPoint, CPIndex, Distance
pt_6 = Point(cps.ClosestPoint)
ln = Line(StartPoint=pt_3, EndPoint=pt_6)
line = Line(ln)
crv_3 = ClusterInput()
crv_4 = Curve([line, crv_3])
srf_2 = Surface(srf)
srfsplit = SurfaceSplit(Surface=srf_2, Curves=flatten(crv_4))
brep = Brep(srfsplit)
smesh = SimpleMesh(Brep=brep)
mjoin = MeshJoin(Meshes=smesh)
weldvertices = MeshWeldVertices(Mesh=mjoin, Tolerance=0.01)  # -> RuntimeMessage, Mesh
unifynormals = MeshUnifyNormals(Mesh=weldvertices.Mesh)
mesh_2 = Mesh(unifynormals)
refine = Refine(Mesh=mesh_2, Level="3")
crv_5 = ClusterInput()
mesh_3 = Mesh(refine)
srf_3 = Surface(srf_2)
crv_6 = Curve(crv_5)
end_2 = EndPoints(Curve=crv_6)  # -> Start, End
debrep_2 = DeconstructBrep(Brep=srf_3)  # -> Faces, Edges, Vertices
nv = NakedVertices(Mesh=mesh_3)  # -> ClothedIndex, NakedIndex, ClothedPts, NakedPts
line_2 = Line(debrep_2.Edges)
midpt = CurveMiddle(Curve=line_2)
pt_7 = Point(midpt)
pt_8 = Point([end_2.End, end_2.Start])
cp = ClosestPoint(Point=simplify(graft(pt_8)), Cloud=pt_7)  # -> ClosestPoint, CPIndex, Distance
item_2 = ListItem(List=line_2, Index=cp.CPIndex, Wrap=True)
pt_9 = Point(nv.NakedPts)
line_3 = Line(item_2)
pull = PullPoint(Point=pt_9, Geometry=line_3, ClosestOnly=True)  # -> ClosestPoint, Distance, Index
smaller = SmallerThan(FirstNumber=pull.Distance, SecondNumber=Slider(0.01, range=0..0.01))  # -> SmallerThan, OrEqualTo
dispatch_2 = Dispatch(List=pt_9, DispatchPattern=smaller.SmallerThan)  # -> ListA, ListB
line_4 = Line(line_3)
midpt_2 = CurveMiddle(Curve=line_4)
len = Length(Curve=line_4)
division = Division(A=len, B="2")
cir = Circle(Plane=midpt_2, Radius=division)
ccx = CurveCurve(CurveA=line_4, CurveB=cir)  # -> Points, ParamsA, ParamsB
shatter_2 = Shatter(Curve=graft(cir), Parameters=ccx.ParamsB)  # -> simplify(Segments)
line_5 = Line(line_4)
curvepoint = PointOnCurve(shatter_2, parameter=0.024)
srf_4 = Surface(srf_3)
end_3 = EndPoints(Curve=line_5)  # -> Start, End
brep_cp = BrepClosestPoint(Point=curvepoint, Brep=srf_4)  # -> Point, Normal, Distance
sort = SortList(Keys=brep_cp.Distance, ValuesA=shatter_2)  # -> Keys, ValuesA
item_3 = ListItem(List=sort.ValuesA, Index="1", Wrap=True)
crv_7 = Curve(item_3)
end_4 = EndPoints(Curve=crv_7)  # -> Start, End
dist = Distance(PointA=end_4.Start, PointB=end_3.Start)
equals_2 = Equality(FirstNumber=dist, SecondNumber="0")  # -> Equality, Inequality
panel_2 = Panel(equals_2.Equality)
dispatch_3 = Dispatch(List=line_5, DispatchPattern=equals_2.Equality)  # -> ListA, ListB
pt_10 = Point(dispatch_2.ListA)
lng_3 = ListLength(List=pt_10)
subtraction = Subtraction(A=lng_3, B=Slider(1, range=0..1))
flip = FlipCurve(Curve=dispatch_3.ListB)  # -> Curve, Flag
divide = DivideCurve(Curve=crv_7, Count=subtraction, Kinks=False)  # -> Points, Tangents, Parameters
merge_3 = Merge(Data1=dispatch_3.ListA, Data2=flip.Curve)
mesh_4 = Mesh(mesh_3)
crv_8 = Curve(merge_3)
medges = MeshEdges(Mesh=mesh_4)  # -> NakedEdges, InteriorEdges, NonManifoldEdges
alongcrv = SortAlongCurve(Points=pt_10, Curve=crv_8)  # -> Points, Indices
pt_11 = Point(divide.Points)
mesh_5 = ClusterOutput(mesh_4)
pt_12 = Point(alongcrv.Points)
line_6 = Line(medges.NakedEdges)
pt_13 = ClusterOutput(pt_11)
pt_14 = ClusterOutput(pt_12)
line_7 = ClusterOutput(line_6)
number_slider = ClusterOutput(Slider(0.01289, range=0..0.04001))

# ==== cluster Cluster_2
A = ClusterInput()
B = ClusterInput()
M = ClusterInput()
F = ClusterInput()
ln = Line(StartPoint=A, EndPoint=B)
pt = ClusterInput()
demesh = DeconstructMesh(Mesh=M)  # -> Vertices, Faces, Colours, Normals
Z = UnitZ(Factor=F)
C = ClusterInput()
pt_2 = Point(pt)
len = Length(Curve=C)
rev = Reverse(Vector=Z)
P = ClusterInput()
T = ClusterInput()
B_2 = ClusterInput()
anchor = Anchor(Point=P, Target=T, Strength=10000)
F_2 = ClusterInput()
multiplication = Multiplication(A=len, B=B_2)
mesh = ClusterInput()
lengthfactor = ClusterInput()
crv = ClusterInput()
line = ClusterInput()
strength = ClusterInput()
G = ClusterInput()
Z_2 = UnitZ(Factor=F_2)
load = Load(Point=pt_2, ForceVector=rev, Weighting=1)
edgelengths = EdgeLengths(Mesh=mesh, LengthFactor=lengthfactor, Strength=1)
crv_2 = Curve(crv)
length_line = LengthLine(Line=line, Length=multiplication, Strength=strength)
load_2 = Load(Point=demesh.Vertices, ForceVector=Z_2, Weighting=1)
show = Show(G=G)
relay = Relay()
merge = Merge(Data1=show, Data2=edgelengths, Data3=load_2, Data4=anchor, Data5=length_line, Data6=load, Data7=relay)
R = ClusterOutput(merge)
