# Grasshopper definition unnamed1.gh (Grasshopper 1.0.8)

py3 = Python3Script()  # -> out, x, a; inputs x: Int32, z: Int32, h: Int32
# ---------- py3: Python ----------
import Rhino
import json
from System.Net import WebClient

def AddBrepPyramid(levels_in, size_in, gap_in):
    levels = int(levels_in) if levels_in is not None else 5
    size = float(size_in) if size_in is not None else 10.0
    gap = float(gap_in) if gap_in is not None else 2.0

    boxes = []
    for layer in range(levels):
        count = levels - layer
        offset_z = layer * (size + gap)
        for i in range(count):
            for j in range(count):
                shift = layer * (size + gap) / 2
                offset_x = i * (size + gap) + shift
                offset_y = j * (size + gap) + shift
                pt0 = Rhino.Geometry.Point3d(offset_x, offset_y, offset_z)
                pt1 = Rhino.Geometry.Point3d(offset_x + size, offset_y + size, offset_z + size)
                box = Rhino.Geometry.BoundingBox(pt0, pt1)
                boxes.append(box.ToBrep())
    return boxes

# fallback на входы GH
web_x, web_h, web_z = x, h, z

url = "http://localhost:3001/api/compute/params"

try:
    wc = WebClient()
    wc.Headers.Add("Accept", "application/json")
    s = wc.DownloadString(url)
    data = json.loads(s)
    web_x = data.get("x", web_x)
    web_h = data.get("h", web_h)
    web_z = data.get("z", web_z)
except:
    pass

a = AddBrepPyramid(web_x, web_h, web_z)
dbg = (web_x, web_h, web_z)
# ---------- end py3 ----------

# ---- group: RH_OUT
mesh = MeshBrep(
    Brep=py3.a,
    Settings={GridMaxCount=0, GridMinCount=16, JaggedSeams=False, MaxEdgeLength=0, MinEdgeLength=0.0001, MinTolerance=0, Refine=True, RefineAngle=0, RelativeTolerance=0.65, SimplePlanes=True, Tolerance=0})

# ----
panel = Panel(py3.x)
